# Grasshopper definition dfCutFillInSurface.gh (Grasshopper 1.0.7)
# plug-ins: Docofossor

# Docofossor
# Cut and Fill in Surface
# link to: /example_DTM.xyz
path = FilePath()
dfimportxyz = ImportXYZ(F=path)
srf = Surface(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)
dfcutfillinsurface = CutFillInSurface(Df=dfimportxyz, Srf=srf)  # -> Df, Vol
dfgridmesh = GridMesh(Df=dfcutfillinsurface.Df)
