# Grasshopper definition dfExportXYZ.gh (Grasshopper 1.0.7)
# plug-ins: Docofossor

# Docofossor
# Export XYZ
# link to: /example_DTM.xyz
path = FilePath()
dfimportxyz = ImportXYZ(MarshallingSignalParameter=path)
dfexportxyz = ExportXYZ(Df=dfimportxyz, F="filename", W=Button())
