# Grasshopper definition dfGridFilter.gh (Grasshopper 1.0.7)
# plug-ins: Docofossor

# Docofossor
# Grid Filter
# link to: /example_DTM.xyz
path = FilePath()
dfimportxyz = ImportXYZ(F=path)
dfgridfilter = GridFilter(Df=dfimportxyz, N="4")
dfgridmesh = GridMesh(Df=dfgridfilter)
