# Grasshopper definition dfNoise.gh (Grasshopper 1.0.7)
# plug-ins: Docofossor

# set to: /examples/example_DTM.xyz
path = FilePath()
dfimportxyz = ImportXYZ(MarshallingSignalParameter=path)
crv = Curve()
dfnoise = Noise(Df=dfimportxyz, Crv=crv, Wl="4", A="2")
dfgridmesh = GridMesh(Df=dfnoise)
